# Grasshopper definition traces.gh (Grasshopper 1.0.7)

number_slider = Slider(0.5, range=0..1)
crv = Curve()
neg = Negative(Value=number_slider)
offset = OffsetCurve(Curve=graft(crv), Distance=[neg, number_slider], Corners=1)
